# Grasshopper definition MeshGenerator1.gh (Grasshopper 1.0.7)
# plug-ins: Kangaroo2 Components

curve = Curve(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)
curve_2 = Curve(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)
curve_3 = Curve(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)
curve_4 = Curve(<curve referenced from the Rhino model>)
curve_5 = Curve(<curve referenced from the Rhino model>)
curve_6 = Curve(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)
curve_7 = Curve(<curve referenced from the Rhino model>)
curve_8 = Curve(<curve referenced from the Rhino model>)
curve_9 = Curve(<curve referenced from the Rhino model>)
curve_10 = Curve(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)
curve_11 = Curve(<curve referenced from the Rhino model>)
curve_12 = Curve(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)
curve_13 = Curve(<curve referenced from the Rhino model>)
curve_14 = Curve(<curve referenced from the Rhino model>)
boundary_surfaces = BoundarySurfaces(Edges=[curve_13, curve_14])
number_slider = Slider(1000, range=0..1000)
number_slider_2 = Slider(30000, range=0..100000)
curve_15 = Curve(<curve referenced from the Rhino model>)
quad_remesh_settings = QuadRemeshSettings(
    TargetCount=Slider(10000, range=0..10000),
    AdaptiveSize=0,
    AdaptiveCount=False,
    HardEdges=False,
    SeamEdges=0,
    Symmetry=0,
    GuideCurves=0)
number_slider_3 = Slider(0.01, range=0..0.01)
number_slider_4 = Slider(43.04, range=0.01..100)
number_slider_5 = Slider(30, range=1..50)
data_dam = DataDam(DataDataA=curve_11, BufferDelay=10000000, BufferMode=0)
X = Slider(2, range=0.1..10000)
Y = Slider(50, range=0.1..10000)
xy = Slider(2, range=0.1..10000)
geometry_pipeline = GeometryPipeline(
    GroupByLayer=False,
    GroupByType=False,
    IncludeHidden=True,
    IncludeLocked=True,
    LayerFilter="X load",
    NameFilter="*",
    SublayerFiltering=True,
    TypeFilter=4)
geometry_pipeline_2 = GeometryPipeline(
    GroupByLayer=False,
    GroupByType=False,
    IncludeHidden=True,
    IncludeLocked=True,
    LayerFilter="Y load",
    NameFilter="*",
    SublayerFiltering=True,
    TypeFilter=4)
quad_remesh_settings_2 = QuadRemeshSettings(
    TargetCount=Slider(8000, range=0..10000),
    AdaptiveSize=0,
    AdaptiveCount=False,
    HardEdges=False,
    SeamEdges=0,
    Symmetry=0,
    GuideCurves=0)
geometry_pipeline_3 = GeometryPipeline(
    GroupByLayer=False,
    GroupByType=False,
    IncludeHidden=True,
    IncludeLocked=True,
    LayerFilter="X supp",
    NameFilter="*",
    SublayerFiltering=True,
    TypeFilter=4)
geometry_pipeline_4 = GeometryPipeline(
    GroupByLayer=False,
    GroupByType=False,
    IncludeHidden=True,
    IncludeLocked=True,
    LayerFilter="Y supp",
    NameFilter="*",
    SublayerFiltering=True,
    TypeFilter=4)
multiplication = Multiplication(A=Slider(4, range=0..100), B=Slider(10000000, range=0..10000000))
quad_remesh = QuadRemesh(Mesh=boundary_surfaces, Settings=quad_remesh_settings)  # disabled
triremesh = TriRemesh(Geometry=data_dam, Features=data_dam, Length=number_slider_4, Iterations=number_slider_5)  # -> Triangulation, Dual, Creases
quad_remesh_2 = QuadRemesh(Mesh=data_dam, Settings=quad_remesh_settings_2)
negative = Negative(Value=Y)
face_boundaries = FaceBoundaries(Mesh=triremesh.Triangulation)
triremesh_2 = TriRemesh(Geometry=boundary_surfaces, Features=data_dam, Length=number_slider_4, Iterations=number_slider_5)  # -> Triangulation, Dual, Creases; disabled
triangulate = Triangulate(Mesh=quad_remesh_2)  # -> Mesh, Count; disabled
area = Area(Geometry=face_boundaries)  # -> Area, Centroid
merge = Merge(Data1=geometry_pipeline, Data2=geometry_pipeline_2)
merge_2 = Merge(Data1=geometry_pipeline_3, Data2=geometry_pipeline_4)
voronoi = Voronoi(Points=area.Centroid, Boundary=data_dam, BruteForceOverride=False)
face_boundaries_2 = FaceBoundaries(Mesh=quad_remesh_2)
list_length = ListLength(List=face_boundaries_2)
panel = Panel(list_length)
explode = Explode(Curve=face_boundaries_2, Recursive=True)  # -> Segments, simplify(Vertices)
create_set = CreateSet(List=flatten(explode.Vertices))  # -> Set, Map
point_in_curves = PointInCurves(Point=create_set.Set, Curves=geometry_pipeline)  # -> Relationship, Index, Point
point_in_curves_2 = PointInCurves(Point=create_set.Set, Curves=geometry_pipeline_2)  # -> Relationship, Index, Point
point_in_curves_3 = PointInCurves(Point=create_set.Set, Curves=merge)  # -> Relationship, Index, Point
point_in_curves_4 = PointInCurves(Point=create_set.Set, Curves=geometry_pipeline_3)  # -> Relationship, Index, Point
point_in_curves_5 = PointInCurves(Point=create_set.Set, Curves=geometry_pipeline_4)  # -> Relationship, Index, Point
point_in_curves_6 = PointInCurves(Point=create_set.Set, Curves=merge_2)  # -> Relationship, Index, Point
equality = Equality(FirstNumber=point_in_curves.Relationship, SecondNumber="0")  # -> Equality, Inequality
equality_2 = Equality(FirstNumber=point_in_curves_2.Relationship, SecondNumber="0")  # -> Equality, Inequality
equality_3 = Equality(FirstNumber=point_in_curves_3.Relationship, SecondNumber="0")  # -> Equality, Inequality
equality_4 = Equality(FirstNumber=point_in_curves_4.Relationship, SecondNumber="0")  # -> Equality, Inequality
equality_5 = Equality(FirstNumber=point_in_curves_5.Relationship, SecondNumber="0")  # -> Equality, Inequality
equality_6 = Equality(FirstNumber=point_in_curves_6.Relationship, SecondNumber="0")  # -> Equality, Inequality
area_2 = Area(Geometry=face_boundaries_2)  # -> Area, Centroid
cull_index = CullIndex(List=explode.Vertices, Indices="-1", Wrap=True)  # -> simplify(List)
cull_duplicates = CullDuplicates(Points=area_2.Centroid, Tolerance="0.00000000000000001", CullMode=3)  # -> Points, Indices, Valence
bounds = Bounds(Numbers=area_2.Area)
member_index = MemberIndex(Set=create_set.Set, Member=cull_index)  # -> Index, Count
gate_and = GateAnd(A=equality.Equality, B=invert(equality_2.Equality))
gate_and_2 = GateAnd(A=equality_2.Equality, B=invert(equality.Equality))
gate_and_3 = GateAnd(A=equality_4.Equality, B=invert(equality_5.Equality))
gate_and_4 = GateAnd(A=equality_5.Equality, B=invert(equality_4.Equality))
gate_and_5 = GateAnd(A=equality.Inequality, B=equality_2.Inequality)
gate_and_6 = GateAnd(A=equality_4.Inequality, B=equality_5.Inequality)
path_mapper = PathMapper(member_index.Index, source="{A;B}", target="{A}")
dispatch = Dispatch(List=point_in_curves_3.Point, DispatchPattern=gate_and)  # -> ListA, ListB
dispatch_2 = Dispatch(List=point_in_curves_3.Point, DispatchPattern=gate_and_2)  # -> ListA, ListB
dispatch_3 = Dispatch(List=point_in_curves_3.Point, DispatchPattern=gate_and_5)  # -> ListA, ListB
dispatch_4 = Dispatch(List=point_in_curves_6.Point, DispatchPattern=gate_and_3)  # -> ListA, ListB
dispatch_5 = Dispatch(List=point_in_curves_6.Point, DispatchPattern=gate_and_4)  # -> ListA, ListB
dispatch_6 = Dispatch(List=point_in_curves_6.Point, DispatchPattern=gate_and_6)  # -> ListA, ListB
panel_2 = Panel(path_mapper)
y_supp = Point(dispatch_4.ListA)
y_load = Point(dispatch.ListA)
x_supp = Point(dispatch_5.ListA)
xy_supp = Point(dispatch_6.ListA)
x_load = Point(dispatch_2.ListA)
xy_load = Point(dispatch_3.ListA)
member_index_2 = MemberIndex(Set=create_set.Set, Member=x_load)  # -> Index, Count
member_index_3 = MemberIndex(Set=create_set.Set, Member=xy_load)  # -> Index, Count
member_index_4 = MemberIndex(Set=create_set.Set, Member=x_supp)  # -> Index, Count
member_index_5 = MemberIndex(Set=create_set.Set, Member=xy_supp)  # -> Index, Count
member_index_6 = MemberIndex(Set=create_set.Set, Member=y_load)  # -> Index, Count
member_index_7 = MemberIndex(Set=create_set.Set, Member=y_supp)  # -> Index, Count
merge_3 = Merge(Data1=flatten(member_index_6.Index), Data2=flatten(member_index_3.Index))  # -> flatten(Result)
list_length_2 = ListLength(List=flatten(member_index_2.Index))
list_length_3 = ListLength(List=flatten(member_index_6.Index))
list_length_4 = ListLength(List=flatten(merge_3))
division = Division(A=X, B=list_length_2)
division_2 = Division(A=negative, B=list_length_3)
division_3 = Division(A=xy, B=list_length_4)
merge_4 = Merge(Data1=division, Data2="0")  # -> flatten(Result)
merge_5 = Merge(Data1=division_3, Data2=division_3)  # -> flatten(Result)
merge_6 = Merge(Data1="0", Data2=division_2)  # -> flatten(Result)
panel_3 = Panel("""1
0""")
panel_4 = Panel("""1
1""")
panel_5 = Panel("""1
0""")
panel_6 = Panel("""0
1""")
insert_items = InsertItems(List=simplify(member_index_2.Index), Item=flatten(merge_4), Indices=flatten("1"), Wrap=True)
insert_items_2 = InsertItems(List=simplify(member_index_3.Index), Item=flatten(merge_5), Indices=flatten("1"), Wrap=True)
insert_items_3 = InsertItems(List=simplify(member_index_4.Index), Item=flatten(panel_3), Indices=flatten("1"), Wrap=True)
insert_items_4 = InsertItems(List=simplify(member_index_5.Index), Item=flatten(panel_4), Indices=flatten("1"), Wrap=True)
insert_items_5 = InsertItems(List=simplify(member_index_6.Index), Item=flatten(merge_6), Indices=flatten("1"), Wrap=True)
insert_items_6 = InsertItems(List=simplify(member_index_7.Index), Item=flatten(panel_6), Indices=flatten("1"), Wrap=True)
entwine = Entwine(Branch0X=insert_items_5, Branch1X=insert_items, Branch2X=insert_items_2, FlattenInputs=False)  # -> simplify(Result)
relay = Relay([member_index_7.Index, member_index_4.Index, member_index_5.Index])
entwine_2 = Entwine(Branch0X=insert_items_6, Branch1X=insert_items_3, Branch2X=insert_items_4, FlattenInputs=False)  # -> simplify(Result)
list_item = ListItem(List=create_set.Set, Index=flatten(relay), Wrap=True)
clean_tree = CleanTree(RemoveNulls=True, RemoveInvalid=True, RemoveEmpty=invert(False), Tree=entwine)  # -> simplify(Tree)
clean_tree_2 = CleanTree(RemoveNulls=True, RemoveInvalid=True, RemoveEmpty=invert(False), Tree=entwine_2)  # -> simplify(Tree)
relay_2 = Relay([member_index_6.Index, member_index_2.Index, member_index_3.Index])
list_item_2 = ListItem(List=create_set.Set, Index=flatten(relay_2), Wrap=True)
custom_preview = CustomPreview(Geometry=list_item, Material=ColourSwatch(SwatchColor=RGB(255, 255, 255)))
custom_preview_2 = CustomPreview(Geometry=list_item_2, Material=ColourSwatch(SwatchColor=RGB(28, 5, 5)))
panel_7 = Panel(clean_tree_2)
panel_8 = Panel(clean_tree)

# ----
# Name of truss
panel_9 = Panel("BudH5L40")
concat = Concatenate(FragmentA="D:\\PolyStressMesh\\", FragmentB=panel_9, FragmentC=" \")
python = GhPythonScript(
    nodes=create_set.Set,
    elements=path_mapper,
    supp=clean_tree_2,
    loads=clean_tree,
    fileName=panel_9,
    filePath=concat,
    write=Button())  # -> out; inputs nodes: list of Point3d, elements: tree, supp: tree, loads: tree
# ---------- python: Python ----------
import os

#print(elements.BranchCount)
#print(elements.Branch(2)[1])
print(loads.BranchCount)

def writeToFile(fullPath, x):
    f = open(fullPath, "w")
    for i in x:
        f.write(str(i) + "\n")
    f.close()

def writeToFileElements(fullPath, x):
    f = open(fullPath, "w")
    for i in range(x.BranchCount):
        for j in range(x.Branch(i).Count):
            f.write(str(int(x.Branch(i)[j]) + 1) + " ")
        f.write("\n")
    f.close()


def writeToFileSupp(fullPath, x):
    f = open(fullPath, "w")
    for i in range(x.BranchCount):
        for j in range(x.Branch(i).Count):
            print(j)
            if j == 0:
                f.write(str(int(x.Branch(i)[j]) + 1) + " ")
            else:
                f.write(str(x.Branch(i)[j]) + " ")
        f.write("\n")
    f.close()

nodesFile = fileName + "_nodes.txt"
elementFile = fileName + "_elements.txt"
suppFile = fileName + "_supps.txt"
forceFile = fileName + "_loads.txt"

fullPathNodes = filePath + nodesFile
fullPathElements = filePath + elementFile
fullPathSupp = filePath + suppFile
fullPathLoad = filePath + forceFile

if write:
    try:
        os.mkdir(filePath)
    except OSError:
        print ("Creation of the directory %s failed" % filePath)
    else:
        print ("Successfully created the directory %s " % filePath)
    writeToFile(fullPathNodes, nodes)
    writeToFileElements(fullPathElements, elements)
    writeToFileSupp(fullPathSupp, supp)
    writeToFileSupp(fullPathLoad, loads)
# ---------- end python ----------

panel_10 = Panel(python)
